# Grasshopper definition test.gh (Grasshopper 1.0.7)

mesh = Mesh(<mesh referenced from the Rhino model>)
mesh_2 = Mesh(<mesh referenced from the Rhino model>)
demesh = DeconstructMesh(Mesh=mesh_2)  # -> Vertices, Faces, Colours, Normals
demesh_2 = DeconstructMesh(Mesh=mesh)  # -> Vertices, Faces, Colours, Normals
pl = PlaneNormal(Origin=demesh_2.Vertices, ZAxis=demesh_2.Normals)
pl_2 = PlaneNormal(Origin=demesh.Vertices, ZAxis=demesh.Normals)
pln = Plane(pl)
pln_2 = Plane(pl_2)
c_script = CSharpScript(
    x=pln_2,
    y=pln,
    Reference="C:\Users\Administrator\Documents\GitHub\MeshClassLibrary\MathNet.Numerics\MathNet.Numerics.dll")  # -> out, A; inputs x: list of Plane, y: list of Plane
# ---------- c_script: C# usings ----------
using MathNet.Numerics.LinearAlgebra.Double;
using MathNet.Numerics.LinearAlgebra.Generic;
using MathNet.Numerics.LinearAlgebra.Double.Factorization;
# ---------- c_script: C# ----------
    try{
      A = KabschEstimate(x, y);
    }catch(Exception ex){
      Print(ex.ToString());
    }
# ---------- c_script: C# additional code ----------
  public Transform KabschEstimate(List<Plane> P, List<Plane> Q)
  {
    List<Quaternion> _P = new List<Quaternion>();
    List<Quaternion> _Q = new List<Quaternion>();
    for (int i = 0; i < P.Count; i++)
    {

      double[] quat = P[i].GetPlaneEquation();
      _P.Add(new Quaternion(quat[1], quat[2], quat[3], quat[0]));
      quat = Q[i].GetPlaneEquation();
      _Q.Add(new Quaternion(quat[1], quat[2], quat[3], quat[0]));
    }
    return KabschEstimate(_P, _Q, "");
  }
  public Transform KabschEstimate(List<Quaternion> P, List<Quaternion> Q, string type)
  {
            /*
            一组空间点匹配另一组空间点 kabsch算法
            将两组点的中心算出来 ，然后平移中点到原点
            协方差矩阵 H = X * Y.transpose();
            [U,S,VT]=SVD(H)
            I=(V*UT).Determinant判断方向
            旋转R = V*I*UT;
            平移T = -R * cenA + cenB;
            新点坐标P=P*T*R
            */
    Transform xf = Transform.Identity;
    if (P.Count != Q.Count) return xf;
    Quaternion CenP = new Quaternion(); Quaternion CenQ = new Quaternion();
    for (int i = 0; i < P.Count; i++)
    {
      CenP += P[i];
      CenQ += Q[i];
    }
    CenP /= P.Count; CenQ /= Q.Count;
    DenseMatrix MX = new DenseMatrix(P.Count, 4);
    DenseMatrix MY = new DenseMatrix(P.Count, 4);
    for (int i = 0; i < P.Count; i++)
    {
      DenseVector v1 = new DenseVector(4);
      DenseVector v2 = new DenseVector(4);
      v1[0] = P[i].A - CenP.A; v2[0] = Q[i].A - CenQ.A;
      v1[1] = P[i].B - CenP.B; v2[1] = Q[i].B - CenQ.B;
      v1[2] = P[i].C - CenP.C; v2[2] = Q[i].C - CenQ.C;
      v1[3] = P[i].D - CenP.D; v2[3] = Q[i].D - CenQ.D;
      MX.SetRow(i, v1); MY.SetRow(i, v2);
    }
    DenseMatrix H = DenseMatrix.OfMatrix(MX.TransposeThisAndMultiply(MY));
    Svd svd = H.Svd(true);
    Matrix<double> UT = svd.U().Transpose();
    Matrix<double> V = svd.VT().Transpose();
    Matrix<double> R = V.Multiply(UT);
    double d = R.Determinant();
    if (d > 0) { d = 1; } else { d = -1; }
    DenseMatrix I = new DenseMatrix(4, 4, new double[] { 1,0,0,0,0,1,0,0,0,0,1,0,0,0,0,d });
    R = V.Multiply(I).Multiply(UT);
    xf.M00 = R[0, 0]; xf.M01 = R[0, 1]; xf.M02 = R[0, 2]; xf.M03 = R[0, 3];
    xf.M10 = R[1, 0]; xf.M11 = R[1, 1]; xf.M12 = R[1, 2]; xf.M13 = R[1, 3];
    xf.M20 = R[2, 0]; xf.M21 = R[2, 1]; xf.M22 = R[2, 2]; xf.M23 = R[2, 3];
    xf.M30 = R[3, 0]; xf.M31 = R[3, 1]; xf.M32 = R[3, 2]; xf.M33 = R[3, 3];
    // CenP.Transform(xf);
    //  Transform tf = Transform.Translation(CenQ - CenP);
    // return Transform.Multiply(tf, xf);
    return xf;
  }
# ---------- end c_script ----------
transform = Transform(Geometry=mesh_2, Transform=c_script.A)
matrix = TransformMatrix(c_script.A, Digits=3)
panel = Panel(c_script.A)
